# Grasshopper definition 02.gh (Grasshopper 0.9.64)

number_slider = Slider(0, range=0..255)  # disabled
number_slider_2 = Slider(255, range=0..255)  # disabled
timer = Timer(TimerInterval=1, Target=rhinoflock_05)  # disabled
surface = Surface(<surface referenced from the Rhino model>)
point = Point([<point referenced from the Rhino model> x10])
mesh = Mesh(<mesh referenced from the Rhino model>)
mesh_2 = Mesh(<mesh referenced from the Rhino model>)
rhinoflock_05 = CSharpScript(startPoints=point, boundary=surface, inputMesh=mesh, outputMesh=mesh_2, reset=Button())  # -> out, outPositions, outTraces, outMesh; inputs startPoints: list of Point3d, boundary: Brep, inputMesh: Mesh, outputMesh: Mesh, reset: Boolean
# ---------- rhinoflock_05: C# ----------
    #region beginscript



    double initialVelocity = 3.400;
    Brep controlsurface;

    if(reset == true) {
      agentCollection.Clear();
      positions.Clear();
      meshCounter = new Mesh();



      controlsurface = boundary;
      meshCounter = outputMesh;
      meshCounter.VertexColors.CreateMonotoneMesh(Color.FromArgb(0));


      //make new points
      Random rnd = new Random();
      for(int i = 0; i < startPoints.Count; ++i) {
        double velX = rnd.NextDouble(); //0.0 to 1.0
        double velY = rnd.NextDouble();
        double velZ = 0;

        Agent agent = new Agent(startPoints[i], new Vector3d(velX, velY, velZ), initialVelocity, boundary, inputMesh);
        agent.controlSurface = controlsurface;
        agentCollection.Add(agent);

      }
    } else {

      positions.Clear();
      for(int i = 0; i < agentCollection.Count; i++) {
        Agent currentAgent = agentCollection[i];
        currentAgent.run(agentCollection);
        positions.Add(currentAgent.location);
        meshCounter = updateMeshCounter(meshCounter, currentAgent.location);

      }

      outPositions = positions;
      outMesh = meshCounter;
    }
    #endregion
# ---------- rhinoflock_05: C# additional code ----------
  #region customCode
  List<Agent> agentCollection = new List<Agent>();
  List<Point3d> positions = new List<Point3d>();
  Mesh meshCounter;


  Mesh updateMeshCounter(Mesh meshCounter, Point3d location) {
    MeshPoint meshPt = meshCounter.ClosestMeshPoint(location, 0.0);
    MeshFace face = meshCounter.Faces[meshPt.FaceIndex];
    //Color colorBefore = meshCounter.ColorAt(meshPt);
    int colorA = meshCounter.VertexColors[face.A].ToArgb();
    int colorB = meshCounter.VertexColors[face.B].ToArgb();
    int colorC = meshCounter.VertexColors[face.C].ToArgb();
    colorA++;
    colorB++;
    colorC++;
    meshCounter.VertexColors[face.A] = Color.FromArgb(colorA);
    meshCounter.VertexColors[face.B] = Color.FromArgb(colorB);
    meshCounter.VertexColors[face.C] = Color.FromArgb(colorC);
    if(face.IsQuad) {
      int colorD = meshCounter.VertexColors[face.D].ToArgb();
      colorD++;
      meshCounter.VertexColors[face.D] = Color.FromArgb(colorD);
    }
    //Color colorAfter = meshCounter.ColorAt(meshPt);
    return meshCounter;
  }

  class Agent {

    //PROPERTIES
    public Point3d location;
    public Vector3d velocity;
    public Vector3d acceleration;
    public double maxForce;
    public double sepDist;
    public double cohDist;
    public double aliDist;
    public double maxSpeed;
    public double boundaryDist;
    public Brep controlSurface;
    public Mesh controlMesh;
    public System.Drawing.Color meshColor;

    //CONSTRUCTOR
    public Agent(Point3d _location, Vector3d _velocity, double _maxSpeed, Brep _boundary, Mesh _inputMesh) {

      this.location = _location;
      this.velocity = _velocity;
      this.maxForce = 0.5;
      this.maxSpeed = 0.200;
      this.sepDist = 0.500;
      this.cohDist = 2.000;
      this.aliDist = 5.000;
      this.boundaryDist = 1.2;
      this.controlSurface = _boundary;
      this.controlMesh = _inputMesh;


    }

    //METHODS
    public void run(List<Agent> agentCollection) {
      //acceleration is the thing that changes

      this.acceleration += seprate(agentCollection); //Vector3d
      this.acceleration += align(agentCollection);  //Vector3d
      this.acceleration += cohesion(agentCollection); //Vector3d

      checkBorder();
      update();
    }


    public void checkBorder() {

      Brep b = this.controlSurface;
      Point3d pt = b.ClosestPoint(this.location);

      Vector3d avoidWall = (pt - this.location)*this.boundaryDist;
      this.acceleration += avoidWall;
      this.location = pt;


    }





    public void update() {

      velocity += acceleration;
      if(velocity.Length > maxSpeed) {

        velocity.Unitize();
        velocity *= maxSpeed;
      }
      location = this.location + velocity;
      acceleration *= 0.0;
      MeshPoint meshPt = this.controlMesh.ClosestMeshPoint(this.location, 0.0);
      this.meshColor = this.controlMesh.ColorAt(meshPt);

    }

    public Vector3d seprate(List<Agent> agentCollection) {

      double desiredseparation = sepDist;
      Vector3d steer = new Vector3d(0, 0, 0);
      int count = 0;
      for(int i = 0; i < agentCollection.Count; i++) {

        Agent other = agentCollection[i];
        double d = this.location.DistanceTo(other.location);


        if(( d > 0 ) && ( d < desiredseparation )) {

          Vector3d diff = this.location - other.location;
          diff.Unitize();
          Vector3d direct = diff / d;
          steer += direct;
          count++;
        }
      }
      if(count > 0) steer = steer / (double) count;
      if(steer.Length > 0) {

        steer.Unitize();
        steer *= maxSpeed;
        steer = steer - velocity;
        if(steer.Length > maxForce) {
          steer.Unitize();
          steer *= maxForce;
        }
      }
      return steer;
    }
    public Vector3d align(List<Agent> agentCollection) {

      double neighbordist = aliDist;
      Vector3d steer = new Vector3d(0, 0, 0);
      int count = 0;
      for(int i = 0; i < agentCollection.Count; i++) {

        Agent other = agentCollection[i];
        double d = this.location.DistanceTo(other.location);
        if(( d > 0 ) && ( d < neighbordist )) {

          steer = steer + other.velocity;
          count++;
        }
      }
      if(count > 0) steer = steer / (double) count;
      if(steer.Length > 0) {

        steer.Unitize();
        steer *= maxSpeed;
        steer = Vector3d.Subtract(steer, velocity);
        if(steer.Length > maxForce) {

          steer.Unitize();
          steer *= maxForce;
        }
      }
      return steer;
    }
    public Vector3d steer(Vector3d target, bool slowdown) {

      Vector3d steer;
      Vector3d desired = target - (Vector3d) this.location;
      double d = desired.Length;

      if(d > 0) {

        desired.Unitize();
        if(( slowdown ) && ( d < 100 )) {
          desired *= maxSpeed * ( d / 100 );

        } else {
          desired *= maxSpeed;
        }
        steer = desired - velocity;
        if(steer.Length > maxForce) {
          steer.Unitize();
          steer *= maxForce;
        }
      } else {
        steer = new Vector3d(0, 0, 0);
      }
      return steer;
    }
    public Vector3d cohesion(List<Agent> agentCollection) {

      double neighbordist = cohDist;
      Vector3d sum = new Vector3d(0, 0, 0);
      int count = 0;
      for(int i = 0; i < agentCollection.Count; i++) {

        Agent other = agentCollection[i];
        double d = this.location.DistanceTo(other.location);
        if(( d > 0 ) && ( d < neighbordist )) {

          sum = sum + (Vector3d) other.location;
          count++;
        }
      }
      if(count > 0) {

        sum = sum / (double) count;
        return steer(sum, false);
      }
      return sum;
    }

  }




  //The base methods, separate, align, cohesion, and seek, are
  //from Daniel Shiffman
  #endregion
# ---------- end rhinoflock_05 ----------
mesh_3 = Mesh(rhinoflock_05.outMesh)  # disabled
meshdisplay_01 = CSharpScript(mesh=mesh_3, max=number_slider_2, min=number_slider)  # -> out, outMesh; inputs mesh: Mesh, max: Int32, min: Int32; disabled
# ---------- meshdisplay_01: C# ----------
    #region beginScript
    Mesh updateMesh = mesh;
        
        
    //color check
    if(max < 0) { max = 0; } 
    if(max > 255) { max = 255; }
    if(min < 0) { min = 0; } 
    if(min > 255) { min = 255; }
        
    //find max value
    int colorMax = 0;
    for(int i = 0; i < updateMesh.VertexColors.Count; i++) {
      int colorInt = updateMesh.VertexColors[i].ToArgb();
      if(colorMax < colorInt) { colorMax = colorInt; }
    }

    //assign colors
    for(int i = 0; i < updateMesh.VertexColors.Count; i++) {
      double value2 = map(updateMesh.VertexColors[i].ToArgb(), 0, colorMax, 0, 255);
      if(value2 < 0) { value2 = 0; }
      if(value2 > 255) { value2 = 255; }
      updateMesh.VertexColors[i] = System.Drawing.Color.FromArgb(0, 0, (int) value2);
    }

    //output
    outMesh = updateMesh;

    #endregion
# ---------- meshdisplay_01: C# additional code ----------
  #region customCode
  double map(double value1, double min1, double max1, double min2, double max2) {
    double value2 = min2 + ( value1 - min1 ) * ( max2 - min2 ) / ( max1 - min1 );
    return value2;
  }
  #endregion
# ---------- end meshdisplay_01 ----------
point_2 = Point(rhinoflock_05.outPositions)
mesh_4 = Mesh(meshdisplay_01.outMesh)  # disabled
