# Grasshopper definition 02.ghx (Grasshopper 0.9.76)

number_slider = Slider(0, range=0..255)  # disabled
number_slider_2 = Slider(255, range=0..255)  # disabled
maxspeed = Slider(0.395, range=0..10)  # disabled
seperation = Slider(0.989, range=0..10)  # disabled
cohesion = Slider(0.529, range=0..10)  # disabled
alignment = Slider(2.78, range=0..10)  # disabled
maxforce = Slider(0.537, range=0..10)  # disabled
button = Button()
button_2 = Button()  # disabled
timer = Timer(TimerInterval=1, Target=rhinoflock_06)  # disabled
timer_2 = Timer(TimerInterval=1, Target=rhinoflock_05)  # disabled
surface = Surface(<surface referenced from the Rhino model>)  # disabled
curve = Curve(<curve referenced from the Rhino model>)  # disabled
surface_2 = Surface(<surface referenced from the Rhino model>)
curve_2 = Curve([<curve referenced from the Rhino model> x2])
rhinoflock_06 = CSharpScript(boundary=surface_2, paths=curve_2, reset=button)  # -> out, outPositions, outTraces, outMesh; inputs boundary: Brep, paths: list of Curve, variables: list of Double, reset: Boolean
# ---------- rhinoflock_06: C# ----------
    #region beginscript



    double initialVelocity = 3.400;

    if(reset == true) {
      agentCollection.Clear();
      positions.Clear();






      //make new points
      Random rnd = new Random();

      for(int i = 0; i < paths.Count; i++) {
        for(int j = 0; j < 250; j++) {

          Point3d pt;
          double t = rnd.NextDouble();
          pt = paths[i].PointAtNormalizedLength(t);
          pt = new Point3d(pt.X + ( rnd.NextDouble() * 2.0 ) - 1.000, pt.Y + rnd.NextDouble() * 2.0 - 1.000, 0);

          double velX = rnd.NextDouble() * initialVelocity; //0.0 to 1.0
          double velY = rnd.NextDouble() * initialVelocity;
          double velZ = 0;

          Agent agent = new Agent(pt, new Vector3d(velX, velY, velZ), variables);
          agent.controlSurface = boundary;
          agent.maxSpeed = rnd.NextDouble() * 0.450;
          if(j % 3 == 0) { agent.leader = true;
            agent.shortPath = paths[i];
          }
          agentCollection.Add(agent);
        }
      }


    } else {

      positions.Clear();
      for(int i = 0; i < agentCollection.Count; i++) {
        Agent currentAgent = agentCollection[i];
        currentAgent.run(agentCollection);
        checkDestination(currentAgent, paths);
        positions.Add(currentAgent.location);

      }

      outPositions = positions;
    }
    #endregion
# ---------- rhinoflock_06: C# additional code ----------
  #region customCode
  List<Agent> agentCollection = new List<Agent>();
  List<Point3d> positions = new List<Point3d>();


  Mesh updateMeshCounter(Mesh meshCounter, Point3d location) {
    MeshPoint meshPt = meshCounter.ClosestMeshPoint(location, 0.0);
    MeshFace face = meshCounter.Faces[meshPt.FaceIndex];
    //Color colorBefore = meshCounter.ColorAt(meshPt);
    int colorA = meshCounter.VertexColors[face.A].ToArgb();
    int colorB = meshCounter.VertexColors[face.B].ToArgb();
    int colorC = meshCounter.VertexColors[face.C].ToArgb();
    colorA++;
    colorB++;
    colorC++;
    meshCounter.VertexColors[face.A] = Color.FromArgb(colorA);
    meshCounter.VertexColors[face.B] = Color.FromArgb(colorB);
    meshCounter.VertexColors[face.C] = Color.FromArgb(colorC);
    if(face.IsQuad) {
      int colorD = meshCounter.VertexColors[face.D].ToArgb();
      colorD++;
      meshCounter.VertexColors[face.D] = Color.FromArgb(colorD);
    }
    //Color colorAfter = meshCounter.ColorAt(meshPt);
    return meshCounter;
  }
  void checkDestination(Agent agent, List<Curve> shortPaths) {
    for(int i = 0; i < shortPaths.Count; i++) {

      double dist = agent.location.DistanceTo(shortPaths[i].PointAtEnd);

      if(dist < 2.000) {
        Random rnd = new Random();
        int index = (int) Math.Floor(rnd.NextDouble() * ( shortPaths.Count - 1 ));
        if(index < 0) { index = 0; }
        Point3d pt = shortPaths[index].PointAtStart;
        pt = new Point3d(pt.X + rnd.NextDouble() * 2.000, pt.Y + rnd.NextDouble() * 1.000, 0.0);
        agent.location = pt;
        break;
      }
    }
  }
  class Agent {

    //CONSTRUCTOR
    public Agent(Point3d _location, Vector3d _velocity, List<double> variables) {
      this.location = _location;
      this.velocity = _velocity;

      if(variables.Count >= 6) {
        this.maxForce = variables[0];
        this.maxSpeed = variables[1];
        this.sepDist = variables[2];
        this.cohDist = variables[3];
        this.aliDist = variables[4];
        this.boundaryDist = variables[5];
      }

    }

    //PROPERTIES
    public Point3d location;
    public Vector3d velocity;
    public Vector3d acceleration;


    public double maxForce = 0.537;
    public double maxSpeed = 0.395;
    public double sepDist = 0.989;
    public double cohDist = 0.529;
    public double aliDist = 2.780;
    public double boundaryDist = 1.2;
    public Brep controlSurface;
    public Curve shortPath;
    public bool leader = false;

    //METHODS
    public void run(List<Agent> agentCollection) {
      //acceleration is the thing that changes

      this.acceleration += seprate(agentCollection); //Vector3d
      this.acceleration += align(agentCollection);  //Vector3d
      this.acceleration += cohesion(agentCollection); //Vector3d

      checkBorder();
      update();
    }
    public Vector3d seprate(List<Agent> agentCollection) {

      double desiredseparation = sepDist;
      Vector3d steer = new Vector3d(0, 0, 0);
      int count = 0;
      for(int i = 0; i < agentCollection.Count; i++) {

        Agent other = agentCollection[i];
        double d = this.location.DistanceTo(other.location);


        if(( d > 0 ) && ( d < desiredseparation )) {

          Vector3d diff = this.location - other.location;
          diff.Unitize();
          Vector3d direct = diff / d;
          steer += direct;
          count++;
        }
      }
      if(count > 0) steer = steer / (double) count;
      if(steer.Length > 0) {

        steer.Unitize();
        steer *= maxSpeed;
        steer = steer - velocity;
        if(steer.Length > maxForce) {
          steer.Unitize();
          steer *= maxForce;
        }
      }
      return steer;
    }
    public Vector3d align(List<Agent> agentCollection) {

      double neighbordist = aliDist;
      Vector3d steer = new Vector3d(0, 0, 0);
      int count = 0;
      for(int i = 0; i < agentCollection.Count; i++) {

        Agent other = agentCollection[i];
        double d = this.location.DistanceTo(other.location);
        if(( d > 0 ) && ( d < neighbordist )) {

          steer = steer + other.velocity;
          count++;
        }
      }
      if(count > 0) steer = steer / (double) count;
      if(steer.Length > 0) {

        steer.Unitize();
        steer *= maxSpeed;
        steer = Vector3d.Subtract(steer, velocity);
        if(steer.Length > maxForce) {

          steer.Unitize();
          steer *= maxForce;
        }
      }
      return steer;
    }
    public Vector3d cohesion(List<Agent> agentCollection) {

      double neighbordist = cohDist;
      Vector3d sum = new Vector3d(0, 0, 0);
      int count = 0;
      for(int i = 0; i < agentCollection.Count; i++) {

        Agent other = agentCollection[i];
        double d = this.location.DistanceTo(other.location);
        if(( d > 0 ) && ( d < neighbordist )) {

          sum = sum + (Vector3d) other.location;
          count++;
        }
      }
      if(count > 0) {

        sum = sum / (double) count;
        return steer(sum, false);
      }
      return sum;
    }
    public Vector3d steer(Vector3d target, bool slowdown) {

      Vector3d steer;
      Vector3d desired = target - (Vector3d) this.location;
      double d = desired.Length;

      if(d > 0) {

        desired.Unitize();
        if(( slowdown ) && ( d < 100 )) {
          desired *= maxSpeed * ( d / 100 );

        } else {
          desired *= maxSpeed;
        }
        steer = desired - velocity;
        if(steer.Length > maxForce) {
          steer.Unitize();
          steer *= maxForce;
        }
      } else {
        steer = new Vector3d(0, 0, 0);
      }
      return steer;
    }
    public void checkBorder() {

      Brep b = this.controlSurface;
      Point3d pt = b.ClosestPoint(this.location);

      Vector3d avoidWall = ( pt - this.location ) * this.boundaryDist;
      this.acceleration += avoidWall;
      this.location = pt;


    }
    public void update() {

      this.velocity += this.acceleration;
      if(this.velocity.Length > this.maxSpeed) {

        this.velocity.Unitize();
        this.velocity *= maxSpeed;
      }

      if(this.leader) {
        double t;
        Vector3d vec;
        this.shortPath.ClosestPoint(this.location, out t);
        Point3d pt = this.shortPath.PointAt(t);
        Point3d pt1 = this.shortPath.PointAt(t + this.maxSpeed);
        vec = pt1 - pt;
        //this.location = pt;
        this.velocity = vec;
      }
      this.location = this.location + this.velocity;
      this.acceleration *= 0.0;

    }

  }




  //The base methods, separate, align, cohesion, and seek, are
  //from Daniel Shiffman
  #endregion
# ---------- end rhinoflock_06 ----------
rhinoflock_05 = CSharpScript(boundary=surface, paths=curve, reset=button_2)  # -> out, outPositions, outTraces, outMesh; inputs boundary: Brep, paths: list of Curve, variables: list of Double, reset: Boolean; disabled
# ---------- rhinoflock_05: C# ----------
    #region beginscript



    double initialVelocity = 3.400;

    if(reset == true) {
      agentCollection.Clear();
      positions.Clear();





      //make new points
      Random rnd = new Random();

      for(int i = 0; i < paths.Count; i++) {
        for(int j = 0; j < 250; j++) {

          Point3d pt = new Point3d(paths[i].PointAtStart.X + ( rnd.NextDouble() * 5.0 ), paths[i].PointAtStart.Y + rnd.NextDouble() * 10.0, 0);

          double velX = rnd.NextDouble() * initialVelocity; //0.0 to 1.0
          double velY = rnd.NextDouble() * initialVelocity;
          double velZ = 0;

          Agent agent = new Agent(pt, new Vector3d(velX, velY, velZ), variables);
          agent.maxSpeed = rnd.NextDouble() * 0.350;
          agent.controlSurface = boundary;

          if(j % 8 == 0) {
            agent.leader = true;
            agent.shortPath = paths[i];
            agentCollection.Add(agent);
          }
        }
      }


    } else {

      positions.Clear();
      for(int i = 0; i < agentCollection.Count; i++) {
        Agent currentAgent = agentCollection[i];
        currentAgent.run(agentCollection);
        //checkDestination(currentAgent, paths);
        positions.Add(currentAgent.location);

      }

      outPositions = positions;
    }
    #endregion
# ---------- rhinoflock_05: C# additional code ----------
  #region customCode
  List<Agent> agentCollection = new List<Agent>();
  List<Point3d> positions = new List<Point3d>();


  Mesh updateMeshCounter(Mesh meshCounter, Point3d location) {
    MeshPoint meshPt = meshCounter.ClosestMeshPoint(location, 0.0);
    MeshFace face = meshCounter.Faces[meshPt.FaceIndex];
    //Color colorBefore = meshCounter.ColorAt(meshPt);
    int colorA = meshCounter.VertexColors[face.A].ToArgb();
    int colorB = meshCounter.VertexColors[face.B].ToArgb();
    int colorC = meshCounter.VertexColors[face.C].ToArgb();
    colorA++;
    colorB++;
    colorC++;
    meshCounter.VertexColors[face.A] = Color.FromArgb(colorA);
    meshCounter.VertexColors[face.B] = Color.FromArgb(colorB);
    meshCounter.VertexColors[face.C] = Color.FromArgb(colorC);
    if(face.IsQuad) {
      int colorD = meshCounter.VertexColors[face.D].ToArgb();
      colorD++;
      meshCounter.VertexColors[face.D] = Color.FromArgb(colorD);
    }
    //Color colorAfter = meshCounter.ColorAt(meshPt);
    return meshCounter;
  }
  void checkDestination(Agent agent, List<Curve> shortPaths) {
    if(agent.leader == false){
      for(int i = 0; i < shortPaths.Count; i++) {
        //double dist = agent.location.DistanceTo(shortPaths[i].PointAtStart);
        double dist = agent.location.DistanceTo(shortPaths[i].PointAtEnd);
        //dist = Math.Min(dist, dist1);
        if(dist < 1.000) {
          Random rnd = new Random();
          int index = (int) Math.Floor(rnd.NextDouble() * ( shortPaths.Count - 1 ));
          if(index < 0) { index = 0; }
          Point3d pt = shortPaths[index].PointAtStart;
          pt = new Point3d(pt.X + rnd.NextDouble() * 3.000, pt.Y + rnd.NextDouble() * 1.000, 0.0);
          agent.location = pt;
          break;
        }
      }
    }
  }
  class Agent {

    //CONSTRUCTOR
    public Agent(Point3d _location, Vector3d _velocity, List<double> variables) {
      this.location = _location;
      this.velocity = _velocity;

      if(variables.Count >= 6) {
        this.maxForce = variables[0];
        this.maxSpeed = variables[1];
        this.sepDist = variables[2];
        this.cohDist = variables[3];
        this.aliDist = variables[4];
        this.boundaryDist = variables[5];
      }

    }

    //PROPERTIES
    public Point3d location;
    public Vector3d velocity;
    public Vector3d acceleration;


    public double maxForce = 0.537;
    public double maxSpeed = 0.395;
    public double sepDist = 0.989;
    public double cohDist = 0.529;
    public double aliDist = 2.780;
    public double boundaryDist = 1.2;
    public Brep controlSurface;
    public Curve shortPath;
    public bool leader = false;

    //METHODS
    public void run(List<Agent> agentCollection) {
      //acceleration is the thing that changes

      this.acceleration += seprate(agentCollection); //Vector3d
      this.acceleration += align(agentCollection);  //Vector3d
      this.acceleration += cohesion(agentCollection); //Vector3d

      checkBorder();
      update();
    }
    public Vector3d seprate(List<Agent> agentCollection) {

      double desiredseparation = sepDist;
      Vector3d steer = new Vector3d(0, 0, 0);
      int count = 0;
      for(int i = 0; i < agentCollection.Count; i++) {

        Agent other = agentCollection[i];
        double d = this.location.DistanceTo(other.location);


        if(( d > 0 ) && ( d < desiredseparation )) {

          Vector3d diff = this.location - other.location;
          diff.Unitize();
          Vector3d direct = diff / d;
          steer += direct;
          count++;
        }
      }
      if(count > 0) steer = steer / (double) count;
      if(steer.Length > 0) {

        steer.Unitize();
        steer *= maxSpeed;
        steer = steer - velocity;
        if(steer.Length > maxForce) {
          steer.Unitize();
          steer *= maxForce;
        }
      }
      return steer;
    }
    public Vector3d align(List<Agent> agentCollection) {

      double neighbordist = aliDist;
      Vector3d steer = new Vector3d(0, 0, 0);
      int count = 0;
      for(int i = 0; i < agentCollection.Count; i++) {

        Agent other = agentCollection[i];
        double d = this.location.DistanceTo(other.location);
        if(( d > 0 ) && ( d < neighbordist )) {

          steer = steer + other.velocity;
          count++;
        }
      }
      if(count > 0) steer = steer / (double) count;
      if(steer.Length > 0) {

        steer.Unitize();
        steer *= maxSpeed;
        steer = Vector3d.Subtract(steer, velocity);
        if(steer.Length > maxForce) {

          steer.Unitize();
          steer *= maxForce;
        }
      }
      return steer;
    }
    public Vector3d cohesion(List<Agent> agentCollection) {

      double neighbordist = cohDist;
      Vector3d sum = new Vector3d(0, 0, 0);
      int count = 0;
      for(int i = 0; i < agentCollection.Count; i++) {

        Agent other = agentCollection[i];
        double d = this.location.DistanceTo(other.location);
        if(( d > 0 ) && ( d < neighbordist )) {

          sum = sum + (Vector3d) other.location;
          count++;
        }
      }
      if(count > 0) {

        sum = sum / (double) count;
        return steer(sum, false);
      }
      return sum;
    }
    public Vector3d steer(Vector3d target, bool slowdown) {

      Vector3d steer;
      Vector3d desired = target - (Vector3d) this.location;
      double d = desired.Length;

      if(d > 0) {

        desired.Unitize();
        if(( slowdown ) && ( d < 100 )) {
          desired *= maxSpeed * ( d / 100 );

        } else {
          desired *= maxSpeed;
        }
        steer = desired - velocity;
        if(steer.Length > maxForce) {
          steer.Unitize();
          steer *= maxForce;
        }
      } else {
        steer = new Vector3d(0, 0, 0);
      }
      return steer;
    }
    public void checkBorder() {

      Brep b = this.controlSurface;
      Point3d pt = b.ClosestPoint(this.location);

      Vector3d avoidWall = ( pt - this.location ) * this.boundaryDist;
      this.acceleration += avoidWall;
      this.location = pt;


    }
    public void update() {

      this.velocity += this.acceleration;
      if(this.velocity.Length > this.maxSpeed) {

        this.velocity.Unitize();
        this.velocity *= maxSpeed;
      }

      if(this.leader) {
        double t;
        Vector3d vec;
        this.shortPath.ClosestPoint(this.location, out t);
        Point3d pt = this.shortPath.PointAt(t);
        Point3d pt1 = this.shortPath.PointAt(t + this.maxSpeed);
        vec = pt1 - pt;
        this.location = pt;
        this.velocity = vec;
      }
      this.location = this.location + this.velocity;
      this.acceleration *= 0.0;

    }

  }




  //The base methods, separate, align, cohesion, and seek, are
  //from Daniel Shiffman
  #endregion
# ---------- end rhinoflock_05 ----------
mesh = Mesh(rhinoflock_05.outMesh)  # disabled
meshdisplay_01 = CSharpScript(mesh=mesh, max=number_slider_2, min=number_slider)  # -> out, outMesh; inputs mesh: Mesh, max: Int32, min: Int32; disabled
# ---------- meshdisplay_01: C# ----------
    #region beginScript
    Mesh updateMesh = mesh;
        
        
    //color check
    if(max < 0) { max = 0; } 
    if(max > 255) { max = 255; }
    if(min < 0) { min = 0; } 
    if(min > 255) { min = 255; }
        
    //find max value
    int colorMax = 0;
    for(int i = 0; i < updateMesh.VertexColors.Count; i++) {
      int colorInt = updateMesh.VertexColors[i].ToArgb();
      if(colorMax < colorInt) { colorMax = colorInt; }
    }

    //assign colors
    for(int i = 0; i < updateMesh.VertexColors.Count; i++) {
      double value2 = map(updateMesh.VertexColors[i].ToArgb(), 0, colorMax, 0, 255);
      if(value2 < 0) { value2 = 0; }
      if(value2 > 255) { value2 = 255; }
      updateMesh.VertexColors[i] = System.Drawing.Color.FromArgb(0, 0, (int) value2);
    }

    //output
    outMesh = updateMesh;

    #endregion
# ---------- meshdisplay_01: C# additional code ----------
  #region customCode
  double map(double value1, double min1, double max1, double min2, double max2) {
    double value2 = min2 + ( value1 - min1 ) * ( max2 - min2 ) / ( max1 - min1 );
    return value2;
  }
  #endregion
# ---------- end meshdisplay_01 ----------
panel = Panel(rhinoflock_05.out)  # disabled
point = Point(rhinoflock_05.outPositions)  # disabled
point_2 = Point(rhinoflock_06.outPositions)
rec = CSharpScript(x=point_2, y=button)  # -> out, A; inputs x: list of Point3d, y: Boolean
# ---------- rec: C# ----------
    if(y){pts.Clear();}
    if(pts.Count > 10){
      pts.RemoveAt(0);
    }
    pts.Add(x);
    A = pts;
# ---------- rec: C# additional code ----------
  List<List<Point3d>> pts = new List<List<Point3d>>();
# ---------- end rec ----------
mesh_2 = Mesh(meshdisplay_01.outMesh)  # disabled
rec_2 = CSharpScript(x=point, y=button_2)  # -> out, A; inputs x: Point3d, y: Boolean; disabled
# ---------- rec_2: C# ----------
    if(y){pts.Clear();}
    if(pts.Count > 10){
      pts.RemoveAt(0);
    }
    pts.Add(x);
    A = pts;
# ---------- rec_2: C# additional code ----------
  List < Point3d > pts = new List<Point3d>();
# ---------- end rec_2 ----------
