# Grasshopper definition 03.ghx (Grasshopper 0.9.64)
# plug-ins: Shortest Walk in Gh

geometry_pipeline = GeometryPipeline(
    GroupByLayer=False,
    GroupByType=False,
    IncludeHidden=True,
    IncludeLocked=True,
    LayerFilter="path",
    NameFilter="*",
    TypeFilter=4)
geometry_pipeline_2 = GeometryPipeline(
    GroupByLayer=False,
    GroupByType=False,
    IncludeHidden=True,
    IncludeLocked=True,
    LayerFilter="core",
    NameFilter="*",
    TypeFilter=1)
geometry_pipeline_3 = GeometryPipeline(
    GroupByLayer=False,
    GroupByType=False,
    IncludeHidden=True,
    IncludeLocked=True,
    LayerFilter="door",
    NameFilter="*",
    TypeFilter=1)
point = Point([<point referenced from the Rhino model> x36])  # disabled
feature = GeometryPipeline(
    GroupByLayer=False,
    GroupByType=False,
    IncludeHidden=False,
    IncludeLocked=False,
    LayerFilter="feature",
    NameFilter="*",
    TypeFilter=1)
connect = CSharpScript(pts=point)  # -> out, A; inputs pts: list of Point3d; disabled
# ---------- connect: C# ----------
    List<Line> lines = new List<Line>();
    for (int i = 0; i < pts.Count; i++)
    {
      for (int j = i + 1; j < pts.Count; j++)
      {
        Line line = new Line(pts[i], pts[j]);
        lines.Add(line);
      }
    }
    A = lines;
# ---------- end connect ----------
paths = Curve([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])  # disabled
boundary = Curve(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)  # disabled
number_slider = Slider(0, range=0..1)  # disabled
number_slider_2 = Slider(0.1, range=0..0.1)  # disabled
number_slider_3 = Slider(0.506, range=0..1)  # disabled
number_slider_4 = Slider(1, range=1..10)  # disabled
button = Button()  # disabled
timer = Timer(TimerInterval=1, Target=thread)  # disabled
door = Point(geometry_pipeline_3)
feature_2 = Point(feature)
core = Point(geometry_pipeline_2)
number_slider_5 = Slider(10000, range=0..10000)  # disabled
number_slider_6 = Slider(100, range=0..100)  # disabled
connect_2 = CSharpScript(source=door, destination=core)  # -> out, A; inputs source: list of Point3d, destination: list of Point3d
# ---------- connect_2: C# ----------
    List<Line> lines = new List<Line>();

    for (int i = 0; i < source.Count; i++)
    {
      for (int j = 0; j < destination.Count; j++)
      {
        Line line = new Line(source[i], destination[j]);
        lines.Add(line);
      }
    }
    A = lines;
# ---------- end connect_2 ----------
connect_3 = CSharpScript(source=core, destination=feature_2)  # -> out, A; inputs source: list of Point3d, destination: list of Point3d; same code as connect_2
connect_4 = CSharpScript(source=door, destination=feature_2)  # -> out, A; inputs source: list of Point3d, destination: list of Point3d; same code as connect_2
curve = Curve(geometry_pipeline)
line = CSharpScript(x=paths)  # -> out, flatten(A); inputs x: Curve; disabled
# ---------- line: C# ----------
    List<Line> lines = new List<Line>();
    Point3d[] points;
    x.DivideByCount(30, true, out points);
    
    
    for (int i = 1; i < points.Length; i++)
    {
      Line line = new Line(points[i - 1], points[i]);
      lines.Add(line);
    }
    A = lines;
# ---------- end line ----------
line_charge = LineCharge(Line=line.A, Charge=1)  # disabled
merge_fields = MergeFields(Fields=line_charge)  # disabled
shortest_walk = ShortestWalk(Curves=curve, WantedPath=connect_4.A)  # -> ShortestWalk, Succession, Direction, Length
shortest_walk_2 = ShortestWalk(Curves=curve, WantedPath=connect_3.A)  # -> ShortestWalk, Succession, Direction, Length
shortest_walk_3 = ShortestWalk(Curves=curve, WantedPath=connect_2.A)  # -> ShortestWalk, Succession, Direction, Length
panel = Panel(merge_fields)  # disabled
scalar_display = ScalarDisplay(Field=merge_fields, Section=boundary, Samples=number_slider_6)  # disabled
tensor_display = TensorDisplay(Field=merge_fields, Section=boundary, Samples=number_slider_5)  # disabled
direction_display = DirectionDisplay(Field=merge_fields, Section=boundary, Samples=number_slider_5)  # disabled
curve_2 = Curve([shortest_walk_3.ShortestWalk, shortest_walk_2.ShortestWalk, shortest_walk.ShortestWalk])
panel_2 = Panel("10")
panel_3 = Panel("30")
panel_4 = Panel("50")
mesh = Mesh(direction_display)  # disabled
rebuild_curve = RebuildCurve(Curve=curve_2, Degree=3, Count="20", Tangents=False)
curve_3 = Curve(rebuild_curve)  # disabled
thread = CSharpScript(
    dynamicCurves=curve_3,
    gravityMult=number_slider,
    centroidStep=number_slider_2,
    distance=number_slider_3,
    skip=number_slider_4,
    reset=button)  # -> out, outCircles, outPoints, outLines, outCurves, outControlPoints; inputs staticPoints: list of Point3d, staticCurves: list of Curve, dynamicCurves: list of Curve, gravityMult: Double, centroidStep: Double, distance: Double, skip: Int32, reset: Boolean; disabled
# ---------- thread: C# ----------
    #region beginScript
    //initialize
    List<Point3d> updateControlPoints = new List<Point3d>();
    List<Circle> updateCircles;// = new List<Circle>();
    List<Point3d> updatePoints;// = new List<Point3d>();
    List<Line> updateLines;// = new List<Line>(curves.Count);
    List<NurbsCurve> updateCurves;
    double gravity = gravityMult;


    //logic
    if (reset) { resetCluster(staticPoints, staticCurves, dynamicCurves, skip, out outDistances); }
    addGravity(gravity);
    findNeighbors(distance, out updateCircles);
    moveToNeighbors(centroidStep, out updatePoints);
    moveToGravity();


    //output
    Print(nodes.Count.ToString());
    output(distance, out updateLines, out updateCurves);
    outControlPoints = updateControlPoints;
    outCircles = updateCircles;
    outPoints = updatePoints;
    outLines = updateLines;
    outCurves = updateCurves;
    #endregion
# ---------- thread: C# additional code ----------
  #region customCode
  Curve[] baseCurves;
  NurbsCurve[] curves2;
  NurbsCurve[] staticCurves2;
  Point3d[] staticPoints;
  List<double> outDistances = new List<double>();
  int start = 0;
  int end = 0;

  List<Node> nodes = new List<Node>();
  List<Edge> edges = new List<Edge>();

  public class Node
  {
    //constructor
    public Node(NurbsCurve _baseCurve, int _baseCurveIndex, int _controlPointIndex, double _mass) {
      this.baseCurve = _baseCurve;
      this.baseCurveIndex = _baseCurveIndex;
      this.controlPointIndex = _controlPointIndex;
      this.point = _baseCurve.Points[this.controlPointIndex].Location;
      this.mass = _mass;
      this.startLength = _baseCurve.GetLength();

      if (this.controlPointIndex > 0) {
        //make search radius
        Point3d currentPoint = this.baseCurve.Points[this.controlPointIndex].Location;
        Point3d previousPoint = this.baseCurve.Points[this.controlPointIndex - 1].Location;
        double isolationDist = currentPoint.DistanceTo(previousPoint);
        double maxDistance = isolationDist * 1.0;
        //save search radius
        this.distance = maxDistance;
      } else { this.distance = 10.0; }
      this.nearNodes = new List<Node>();
    }

    //properties
    public NurbsCurve baseCurve;
    public int baseCurveIndex;
    public int controlPointIndex;
    public Point3d point = Point3d.Origin;
    public Vector3d force = Vector3d.Zero;
    public Vector3d dampingForce = Vector3d.Zero;
    public double mass = 0.0;
    public bool anchor = false;
    public int constrain = -1;
    public List<Node> neighbors = new List<Node>();
    public Point3d centroid;
    public double startLength;
    public Vector3d lineVector;
    public List<Node> nearNodes;
    public double distance;

    //methods
    public void step(List<Curve> constrainCurves) {
      if (this.anchor) {
        return;
      }
      double damping = 0.8;
      double dt = 0.7;
      this.dampingForce *= damping;
      this.dampingForce += this.force * (dt / this.mass);
      this.point += this.dampingForce * dt;

      if (constrain >= 0) {
        Curve currentConstraint = constrainCurves[this.constrain];
        double t;
        currentConstraint.ClosestPoint(this.point, out t);
        this.point = currentConstraint.PointAt(t);
      }

      this.force = Vector3d.Zero;
    }
    public void calculateCentroid() {
      double avgX = 0, avgY = 0, avgZ = 0;
      for (int j = 0; j < neighbors.Count; ++j) {
        avgX += neighbors[j].point.X;
        avgY += neighbors[j].point.Y;
        avgZ += neighbors[j].point.Z;
      }
      avgX = avgX / neighbors.Count;

      avgY = avgY / neighbors.Count;
      avgZ = avgZ / neighbors.Count;

      this.centroid = new Point3d(avgX, avgY, avgZ);
    }
    public void stepToCentroid(double centroidStep, out Point3d updatePoint) {
      updatePoint = Point3d.Origin;
      //updatePoint = null;

      if (this.neighbors.Count > 0) {
        if (this.controlPointIndex < baseCurve.Points.Count - 1) {
          Vector3d direction = this.centroid - this.point;

          Vector3d lineDirection1 = direction;
          Vector3d lineVector1 = new Vector3d(this.baseCurve.Points[controlPointIndex - 1].Location - this.baseCurve.Points[controlPointIndex].Location);
          lineDirection1.Unitize();
          lineVector1.Unitize();
          double parallel1 = lineDirection1 * lineVector1;


          Vector3d lineDirection2 = direction;
          Vector3d lineVector2 = new Vector3d(this.baseCurve.Points[controlPointIndex].Location - this.baseCurve.Points[controlPointIndex + 1].Location);
          lineDirection2.Unitize();
          lineVector2.Unitize();
          double parallel2 = lineDirection2 * lineVector2;


          if (Math.Abs(parallel1) < 0.8 && Math.Abs(parallel2) < 0.8) {
            this.force += direction * centroidStep;
            updatePoint = this.centroid;
          }
        }
      }
    }  //end stepToCentroid()
    public void calculateNear(List<Node> nodes, int start, int end, out int updatedStart, out int updatedEnd, out List<double> outDistance) {
      this.nearNodes.Clear();
      outDistance = new List<double>();

      updatedStart = 0;
      updatedEnd = nodes.Count;


      for (int i = 0; i < nodes.Count; ++i) {
        if (this != nodes[i]) {
          double currentDistance = this.point.DistanceTo(nodes[i].point);

          //          if ((this.distance * -2.0) < nodes[i].point.X - this.point.X) {
          //            //updatedStart = i;
          //          }

          if (currentDistance < this.distance * 2.5) {
            this.nearNodes.Add(nodes[i]);
          }


          if ((nodes[i].point.X - this.point.X) > this.distance * 2.0) {
            return;
          }
        }
      }
    }
  }//end Node class
  public class Edge
  {
    //constructor
    public Edge(Node _node0, Node _node1, double _springConstant, double _startLength) {
      this.node0 = _node0;
      this.node1 = _node1;
      this.springConstant = _springConstant;
      this.startLength = _startLength;
    }
    //properties
    public Node node0;
    public Node node1;
    public double startLength;
    public double springConstant;
    //methods
    public void applySpringForce() {
      Vector3d dv = node1.point - node0.point;
      double length = dv.Length;
      dv.Unitize();
      node0.force += dv * (springConstant * (length - startLength)) * 0.5;
      node1.force -= dv * (springConstant * (length - startLength)) * 0.5;
    }
  }//end Edge class

  void resetCluster(List<Point3d> _staticPoints, List<Curve> _staticCurves, List<Curve> _curves, int _skip, out List<double> _outDistances) {
    baseCurves = new Curve[_curves.Count];
    curves2 = new NurbsCurve[_curves.Count];
    staticCurves2 = new NurbsCurve[_staticCurves.Count];
    nodes.Clear();
    edges.Clear();
    outDistances.Clear();


    //static curves
    List<Point3d> allControlPoints = copyStaticPoints(_staticPoints, _staticCurves);

    //dynamic curves
    dynamicCurves(_skip, _curves, allControlPoints);

    //sort nodes
    Comparison<Node> compareNodes = new Comparison<Node>(nodeSort);
    nodes.Sort(compareNodes);
    start = 0;
    end = nodes.Count;

    //calculate Near
    List<double> outDists = new List<double>();
    for (int i = 0; i < nodes.Count; ++i) {
      List<double> outDist;
      nodes[i].calculateNear(nodes, start, end, out start, out end, out outDist);
      outDists.AddRange(outDist);
    }
    _outDistances = outDists;
  }
  List<Point3d> copyStaticPoints(List<Point3d> _staticPoints, List<Curve> _staticCurves) {
    //static curves
    List<Point3d> _points = new List<Point3d>();
    try {
      for (int i = 0; i < _staticCurves.Count; ++i) {
        NurbsCurve currentCurve = _staticCurves[i].ToNurbsCurve();
        for (int j = 0; j < currentCurve.Points.Count; ++j) {
          _points.Add(currentCurve.Points[j].Location);
        }
      }
    } catch { }

    //static points
    for (int i = 0; i < _staticPoints.Count; ++i) {
      _points.Add(_staticPoints[i]);
    }
    staticPoints = _points.ToArray();
    return _points;

  }
  void dynamicCurves(int _skip, List<Curve> _curves, List<Point3d> allControlPoints) {
    if (_skip < 1) { _skip = 1; }
    for (int i = 0; i < _curves.Count; i += _skip) {

      baseCurves = _curves.ToArray();
      NurbsCurve currentCurve = _curves[i].ToNurbsCurve();
      //check if the line has no control points
      if (currentCurve.Points.Count <= 2) { currentCurve = divide(currentCurve); }
      curves2[i] = currentCurve;

      //put control points in a list
      for (int j = 0; j < currentCurve.Points.Count; ++j) {
        allControlPoints.Add(currentCurve.Points[j].Location);
      }

      //make Nodes
      Node[] currentNodes = new Node[currentCurve.Points.Count];
      for (int j = 0; j < currentCurve.Points.Count; ++j) {
        currentNodes[j] = new Node(currentCurve, i, j, 1.0);
        nodes.Add(currentNodes[j]);
      }

      //make edges
      for (int j = 1; j < currentNodes.Length; ++j) {
        edges.Add(new Edge(currentNodes[j - 1], currentNodes[j], 1.0, currentNodes[j - 1].point.DistanceTo(currentNodes[j].point)));
      }
      //anchor points at the ends
      currentNodes[0].anchor = true;
      currentNodes[currentNodes.Length - 1].anchor = true;

    }//end each curve
  }
  int xyzAscending(Point3d A, Point3d B) {
    int positiveOrNegative = A.X.CompareTo(B.X);
    if (positiveOrNegative == 0) {
      positiveOrNegative = A.Y.CompareTo(B.Y);
    }
    if (positiveOrNegative == 0) {
      positiveOrNegative = A.Z.CompareTo(B.Z);
    }
    return positiveOrNegative;
  }
  int nodeSort(Node A, Node B) {
    int positiveOrNegative = A.point.X.CompareTo(B.point.X);
    return positiveOrNegative;
  }
  NurbsCurve divide(Curve currentCurve) {
    int divisions = 30;
    Point3d[] points = new Point3d[divisions];
    double[] ts = currentCurve.DivideByCount(divisions - 1, true);
    for (int j = 0; j < ts.Length; ++j) {
      points[j] = currentCurve.PointAt(ts[j]);
    }
    return Curve.CreateControlPointCurve(points).ToNurbsCurve();
  }
  void addGravity(double gravity) {
    for (int i = 0; i < nodes.Count; ++i) {
      if (!nodes[i].anchor) {
        nodes[i].force = Vector3d.ZAxis * gravity;
        //      foreach (Point3d pa in atr) {
        //        Vector3d dv = pa - n.p;
        //        double L = dv.Length;
        //        dv.Unitize();
        //        Vector3d dvp = new Vector3d(-dv.Y, dv.X, 0.0);
        //        n.f += dv * Math.Exp(-0.01 * L * L) * 0.2;
        //      }
      }
    }
    for (int i = 0; i < edges.Count; ++i) {
      edges[i].applySpringForce();
    }
  }
  void findNeighbors(double distance, out List<Circle> updateCircles) {
    updateCircles = new List<Circle>();
    //for each node
    for (int i = 0; i < nodes.Count; ++i) {
      nodes[i].neighbors.Clear();
      if (nodes[i].controlPointIndex > 0) {
        //make search radius
        Point3d currentPoint = curves2[nodes[i].baseCurveIndex].Points[nodes[i].controlPointIndex].Location;
        Point3d previousPoint = curves2[nodes[i].baseCurveIndex].Points[nodes[i].controlPointIndex - 1].Location;
        double isolationDist = currentPoint.DistanceTo(previousPoint);
        double maxDistance = isolationDist * distance;
        //save search radius
        nodes[i].distance = maxDistance;
        updateCircles.Add(new Circle(currentPoint, maxDistance));


        //compare to all nodes that are close by
        if (nodes[i].nearNodes.Count > 0) {
          for (int j = 0; j < nodes[i].nearNodes.Count; ++j) {
            Node otherNode = nodes[i].nearNodes[j];
            if (i != j && nodes[i].baseCurveIndex != otherNode.baseCurveIndex) {
              //distance calculation
              double currentDist = Math.Abs(nodes[i].point.DistanceTo(otherNode.point));
              if (currentDist < maxDistance) {
                nodes[i].neighbors.Add(otherNode);
              }
            }
          }
        }

        ////static curves
        //for (int j = 0; j < staticPoints.Length; ++j) {
        //    double currentDist = Math.Abs(nodes[i].point.DistanceTo(staticPoints[j]));
        //    if (currentDist < maxDistance) {
        //        Point3d[] singlePoint = new Point3d[2];
        //        singlePoint[0] = staticPoints[j];
        //        singlePoint[1] = staticPoints[j];
        //        NurbsCurve singleCurve = Curve.CreateControlPointCurve(singlePoint).ToNurbsCurve();
        //        nodes[i].neighbors.Add(new Node(singleCurve, 0, 0, 1.0));
        //    }
        //}




      }
    }
  }
  void moveToNeighbors(double centroidStep, out List<Point3d> updatePoints) {
    updatePoints = new List<Point3d>();
    for (int i = 0; i < nodes.Count; ++i) {
      nodes[i].calculateCentroid();
      Point3d updatePoint;
      nodes[i].stepToCentroid(centroidStep, out updatePoint);
      updatePoints.Add(updatePoint);
    }
  }
  void moveToGravity() {
    List<Curve> constrainCurves = null;
    for (int i = 0; i < nodes.Count; ++i) {
      nodes[i].step(constrainCurves);
    }
  }
  void output(double distance, out List<Line> updateLines, out List<NurbsCurve> updateCurves) {
    updateLines = new List<Line>();
    updateCurves = new List<NurbsCurve>();
    Plane groundPlane = new Plane(new Point3d(0, 0, 0), new Vector3d(0, 0, 1));


    for (int i = 1; i < edges.Count; ++i) {
      updateLines.Add(new Line(edges[i].node0.point, edges[i].node1.point));
    }
    for (int i = 1; i < edges.Count; ++i) {
      ControlPoint currentControlPoint0 = new ControlPoint(edges[i].node0.point);
      ControlPoint currentControlPoint1 = new ControlPoint(edges[i].node1.point);
      curves2[edges[i].node0.baseCurveIndex].Points[edges[i].node0.controlPointIndex] = currentControlPoint0;
      curves2[edges[i].node1.baseCurveIndex].Points[edges[i].node1.controlPointIndex] = currentControlPoint1;
    }
    updateCurves = curves2.ToList();
  }
  #endregion
# ---------- end thread ----------
curve_4 = Curve(thread.outCurves)  # disabled
