# Grasshopper definition persp.ghx (Grasshopper 0.9.76)

number_slider = Slider(10, range=0..10)
point = Point(<point referenced from the Rhino model>)
brep = Brep([<brep referenced from the Rhino model> x5])
scale = CSharpScript(cameraPt=point, fullsizeShape=brep, newHeight=Slider(17, range=0..100), scaleZ=Slider(1, range=0..1))  # -> out, A; inputs cameraPt: Point3d, fullsizeShape: list of Brep, newHeight: Double, scaleZ: Double
# ---------- scale: C# ----------
    Brep[] breps = new Brep[fullsizeShape.Count];
    BoundingBox bb = fullsizeShape[0].GetBoundingBox(true);
    for (int i = 1; i < fullsizeShape.Count; i++)
    {
      bb.Union(fullsizeShape[i].GetBoundingBox(true));
    }
    Point3d fullsizePt = bb.Center;
    fullsizePt.Z = cameraPt.Z;

    Line line = new Line(cameraPt, fullsizePt);
    double fullsizeHeight = bb.Max.Z - bb.Min.Z;
    if(fullsizeHeight <= 0) { return; }
    double scaleY = newHeight / fullsizeHeight;
    scaleZ *= scaleY;
    Plane plane = new Plane(cameraPt, line.Direction);


    Transform sca = Transform.Scale(plane, scaleY, scaleY, scaleZ);

    for(int i = 0; i < fullsizeShape.Count; i++) {
      breps[i] = fullsizeShape[i].DuplicateBrep();
      breps[i].Transform(sca);

    }

    A = breps;
# ---------- end scale ----------
