# Grasshopper definition panel.ghx (Grasshopper 0.9.76)

width = Slider(100, range=0..100)
max_rotation = Slider(0, range=0..90)
base_surface = Surface(<surface referenced from the Rhino model>)
paneldivide = CSharpScript(surfaces=base_surface, width=width)  # -> out, outGraph; inputs surfaces: list of Surface, width: Double
# ---------- paneldivide: C# ----------
    #region beginScript


    List<double> updateGraph = new List<double>();


    Surface[] ss = surfaces.ToArray();
    int u = 0;
    int v = 1;


    for (int i = 0; i < ss.Length; i++) {
      Curve pivotLine = (ss[i].IsoCurve(u, ss[i].Domain(v).Max));
      Point3d[] pivotPts = pivotLine.DivideEquidistant(width);
      for (int j = 0; j < pivotPts.Length; j++) {
        double param = map(j, 0, pivotPts.Length, 0, 1.0);

        updateGraph.Add(param);

      }
      outGraph = updateGraph;

    }




    #endregion
# ---------- paneldivide: C# additional code ----------
  public double map(double number, double low1, double high1, double low2, double high2) {
    return low2 + (high2 - low2) * (number - low1) / (high1 - low1);
  }
# ---------- end paneldivide ----------
graph_mapper = GraphMapper(
    paneldivide.outGraph,
    x0=0,
    x1=1,
    y0=0,
    y1=1,
    container_name="Bezier",
    cpx=[0, 0.6345713735, 0.4114285707, 1],
    cpy=[0, 0.03594219685, 0.9971014857, 1])
panel = Panel(paneldivide.outGraph)
panel_2 = Panel(graph_mapper)
panelrotate = CSharpScript(surfaces=base_surface, graph=graph_mapper, rotation=max_rotation)  # -> out, A, B, C; inputs surfaces: list of Surface, graph: list of Double, rotation: list of Double
# ---------- panelrotate: C# ----------
    #region beginScript


    List<Mesh> updateMeshes = new List<Mesh>();
    List<Curve> updateCurves = new List<Curve>();
    List<Point3d> updatePoints = new List<Point3d>();
    List<Plane> updatePlanes = new List<Plane>();


    Surface[] ss = surfaces.ToArray();
    int u = 0;
    int v = 1;


    for (int i = 0; i < ss.Length; i++) {
      Curve pivotLine = (ss[i].IsoCurve(u, ss[i].Domain(v).Max));
      Point3d[] pivotPts = pivotLine.DivideEquidistant(width[0]);
      for (int j = 0; j < pivotPts.Length; j++) {
        double param;
        pivotLine.ClosestPoint(pivotPts[j], out param);
        Plane plane;
        pivotLine.FrameAt(param, out plane);


        //Vector3d normal = ss[i].NormalAt(        ss[i].NormalAt(ss[i].Domain(v).Mid), param)
        //Plane plane = new Plane()
        //  Vector3d.CrossProduct(Vector3d.ZAxis,normal );


      }

      updatePoints.AddRange(pivotPts);

    }


    outMesh = updateMeshes;
    A = updateCurves;
    B = updatePoints;
    C = updatePlanes;

    #endregion
# ---------- end panelrotate ----------
